# Grasshopper definition force simulation_ice.gh (Grasshopper 1.0.7)
# plug-ins: Kangaroo Components

# ----
# Anchor Height
number_slider = Slider(1, range=0..10)

# ----
# FRP Diameter
D = Slider(0.05, range=0..0.2)
division = Division(A=D, B="2")

# ----
# Ice Thickness
t = Slider(0.03, range=0..0.1)
# Ice Diameter
D_2 = Slider(0.16, range=0..0.2)

# ----
# PE Thickness
t_2 = Slider(0.01, range=0..0.01)
# PE Diameter
D_3 = Slider(0.1, range=0..0.1)

crv = Curve([<curve referenced from the Rhino model> x5])
explode = Explode(Curve=crv, Recursive=True)  # -> Segments, Vertices
graft = GraftTree(Tree=explode.Segments, IncludeEmptyLists=True, IncludeNullItems=True)

end = EndPoints(Curve=explode.Segments)  # -> Start, End
item = ListItem(List=reverse(end.End), Index=0, Wrap=True)
merge = Merge(Data1=end.Start, Data2=item)
pline = PolyLine(Vertices=merge, Closed=False)
cp = ControlPoints(Curve=pline)  # -> Points, Weights, Knots
lng = ListLength(List=cp.Points)

# ---- group: ICE
eval = Evaluate(F="D-t*2", D=D_2, t=t)
panel = Panel("7E9")
eval_2 = Evaluate(F="π*(x²-y²)/4", x=D_2, y=eval)
eval_3 = Evaluate(F="π*(x^4-y^4)/64", x=D_2, y=eval)
len = Length(Curve=graft)
multiplication = Multiplication(A=panel, B=eval_2)
multiplication_2 = Multiplication(A=panel, B=eval_3)
avr = Average(Input=flatten(len))
expression = Expression(x=multiplication_2, y=avr, Expression="x/y^2")
expression_2 = Expression(x=multiplication, y=avr, Expression="x/y")
panel_2 = Panel(expression)

# ---- group: FRP
eval_4 = Evaluate(F="D-t*2", D=D, t=division)
panel_3 = Panel("4E10")
eval_5 = Evaluate(F="π*(x²-y²)/4", x=D, y=eval_4)
len_2 = Length(Curve=graft)
eval_6 = Evaluate(F="π*(x^4-y^4)/64", x=D, y=eval_4)
avr_2 = Average(Input=flatten(len_2))
multiplication_3 = Multiplication(A=panel_3, B=eval_5)
multiplication_4 = Multiplication(A=panel_3, B=eval_6)
expression_3 = Expression(x=multiplication_4, y=avr_2, Expression="x/y^2")
expression_4 = Expression(x=multiplication_3, y=avr_2, Expression="x/y")
panel_4 = Panel(expression_3)

# ---- group: Length Distribution
len_3 = Length(Curve=explode.Segments)
division_2 = Division(A=len_3, B="2")
ins = InsertItems(List=division_2, Item="0", Indices="0", Wrap=True)
addition = Addition(A=simplify(division_2), B=simplify(ins))

# ---- group: Close Curve Ends Bend
cls = Closed(Curve=pline)  # -> Closed, Periodic
dispatch = Dispatch(List=pline, DispatchPattern=cls.Closed)  # -> ListA, ListB
cp_2 = ControlPoints(Curve=dispatch.ListA)  # -> Points, Weights, Knots
item_2 = ListItem(List=reverse(cp_2.Points), Index=1, Wrap=True)  # -> flatten(Item)
item_3 = ListItem(List=cp_2.Points, Index=0, Wrap=True)  # -> flatten(Item)
item_4 = ListItem(List=cp_2.Points, Index=1, Wrap=True)  # -> flatten(Item)
vec2pt = Vector2Pt(PointA=item_4, PointB=item_3, Unitize=False)  # -> Vector, Length
vec2pt_2 = Vector2Pt(PointA=item_2, PointB=item_3, Unitize=False)  # -> Vector, Length
angle = Angle(VectorA=vec2pt_2.Vector, VectorB=vec2pt.Vector)  # -> Angle, Reflex
larger = LargerThan(FirstNumber=angle.Angle, SecondNumber="2.5")  # -> LargerThan, OrEqualTo

# ---- group: Ice Gravity
eval_7 = Evaluate(F="D-t*2", D=D_2, t=t)
eval_8 = Evaluate(F="π*(x²-y²)/4", x=D_2, y=eval_7)
expression_5 = Expression(x=eval_8, y=addition, z="800", Expression="x*y*z*9.8")

# ---- group: PE Gravity
eval_9 = Evaluate(F="D-t*2", D=D_3, t=t_2)
eval_10 = Evaluate(F="π*(x²-y²)/4", x=D_3, y=eval_9)
expression_6 = Expression(x=eval_10, y=addition, z="1000", Expression="x*y*z*9.8")

# ---- group: FRP Gravity
eval_11 = Evaluate(F="D-t*2", D=D, t=division)
eval_12 = Evaluate(F="π*(x²-y²)/4", x=D, y=eval_11)
expression_7 = Expression(x=eval_12, y=addition, z="2000", Expression="x*y*z*9.8")

# ---- group: Load
multiplication_5 = Multiplication(A="1.16", B=Slider(0, range=0..1))
multiplication_6 = Multiplication(A=addition, B=multiplication_5)

# ---- group: Curve Bend
dom = ConstructDomain(DomainStart=1, DomainEnd=expr("x-2", lng))
dom_2 = ConstructDomain(DomainStart=2, DomainEnd=expr("x-1", lng))
dom_3 = ConstructDomain(DomainStart=0, DomainEnd=expr("x-3", lng))
subset = SubList(List=cp.Points, Domain=dom_3, Wrap=True)  # -> List, Index
subset_2 = SubList(List=cp.Points, Domain=dom, Wrap=True)  # -> List, Index
subset_3 = SubList(List=cp.Points, Domain=dom_2, Wrap=True)  # -> List, Index

# ---- group: Wind Load
len_4 = Length(Curve=crv)
mcx = MultipleCurves(Curves=crv)  # -> Points, IndexA, IndexB, ParamA, ParamB
ma = MassAddition(Input=len_4)  # -> Result, PartialResults
multiplication_7 = Multiplication(A=ma.Result, B="0")
lng_2 = ListLength(List=mcx.Points)
division_3 = Division(A=multiplication_7, B=lng_2)
multiplication_8 = Multiplication(A=division_3, B="1.4")
Y = UnitY(Factor=multiplication_8)
X = UnitX(Factor=multiplication_8)
uforce = UnaryForce(Point=mcx.Points, Force=Y)

# ---- group: Total Gravity
addition_2 = Addition(A=expression_5, B=expression_6, C=multiplication_6, D=expression_7)
multiplication_9 = Multiplication(A=addition_2, B="1.0")
panel_5 = Panel(addition_2)
Z = UnitZ(Factor=expr("-x", multiplication_9))
uforce_2 = UnaryForce(Point=cp.Points, Force=Z)

# ---- group: Anchor
cp_3 = ControlPoints(Curve=crv)  # -> Points, Weights, Knots
pdecon = Deconstruct(Point=cp_3.Points)  # -> XComponent, YComponent, ZComponent
smaller = SmallerThan(FirstNumber=pdecon.ZComponent, SecondNumber=number_slider)  # -> SmallerThan, OrEqualTo
dispatch_2 = Dispatch(List=cp_3.Points, DispatchPattern=smaller.SmallerThan)  # -> ListA, ListB
pt = Point(flatten(dispatch_2.ListA))

# ---- group: Ice Bend
subtraction = Subtraction(A=angle.Reflex, B=3.141592654)
bend = Bend(Point1=item_2, Point2=item_3, Point3=item_4, BendStrength=expression, RestAngle=subtraction)
dispatch_3 = Dispatch(List=bend, DispatchPattern=larger.LargerThan)  # -> ListA, ListB
clean = CleanTree(RemoveNulls=True, RemoveInvalid=True, RemoveEmpty=False, Tree=dispatch_3.ListA)

vec2pt_3 = Vector2Pt(PointA=subset_2.List, PointB=subset_3.List, Unitize=False)  # -> Vector, Length
vec2pt_4 = Vector2Pt(PointA=subset.List, PointB=subset_2.List, Unitize=False)  # -> Vector, Length
angle_2 = Angle(VectorA=vec2pt_4.Vector, VectorB=vec2pt_3.Vector)  # -> Angle, Reflex
bend_2 = Bend(Point1=subset.List, Point2=subset_2.List, Point3=subset_3.List, BendStrength=expression, RestAngle=angle_2.Angle)

# ---- group: FRP Bend
bend_3 = Bend(Point1=item_2, Point2=item_3, Point3=item_4, BendStrength=expression_3, RestAngle=0)
dispatch_4 = Dispatch(List=bend_3, DispatchPattern=larger.LargerThan)  # -> ListA, ListB
clean_2 = CleanTree(RemoveNulls=True, RemoveInvalid=True, RemoveEmpty=False, Tree=dispatch_4.ListA)

# ---- group: Tension & Compression
addition_3 = Addition(A=expression_4, B=expression_2)
springs = SpringsFromLine(Connection=graft, Stiffness=addition_3, Damping=10, RestLength=graft, UpperCutoff=0, LowerCutoff=0, Plasticity=0)

# ----
kangaroo_settings = KangarooSettings(
    Tolerance=0.001,
    TimeStep=2e-05,
    SubIterations=10,
    Floor=True,
    Drag=1,
    Restitution=0.7,
    StaticFriction=30,
    KineticFriction=30,
    Settle=2,
    Tumble=1,
    Sound=False,
    Solver=0)

# ---- group: FRP Bend
bend_4 = Bend(Point1=subset.List, Point2=subset_2.List, Point3=subset_3.List, BendStrength=expression_3, RestAngle=0)

# ----
timer = Timer(TimerInterval=10, Target=kangaroo)  # disabled
kangaroo = KangarooPhysics(
    ForceObjects=flatten([springs, uforce_2, bend_4, uforce, clean_2, clean, bend_2]),
    AnchorPoints=pt,
    Settings=kangaroo_settings,
    Geometry=explode.Segments,
    SimulationReset=Toggle(False))  # -> Out, Iterations, ParticlesOut, GeometryOut, KE
panel_6 = Panel(kangaroo.Iterations)
panel_7 = Panel(kangaroo.KE)
crv_2 = Curve(flatten(kangaroo.GeometryOut))
crv_3 = Curve(flatten(explode.Segments))
crv_4 = Curve(kangaroo.GeometryOut)

# ---- group: Current Radius of Curvature
end_2 = EndPoints(Curve=crv_4)  # -> Start, End
item_5 = ListItem(List=end_2.Start, Index=0, Wrap=True)
merge_2 = Merge(Data1=item_5, Data2=end_2.End)
cull_i = CullIndex(List=merge_2, Indices="-1", Wrap=True)
shift = ShiftList(List=cull_i, Shift=2, Wrap=True)
shift_2 = ShiftList(List=cull_i, Shift=1, Wrap=True)
circle = Circle3Pt(PointA=cull_i, PointB=shift_2, PointC=shift)  # -> Circle, Plane, simplify(Radius)
shift_3 = ShiftList(List=circle.Radius, Shift=-1, Wrap=True)
addition_4 = Addition(A=circle.Radius, B=shift_3)
division_4 = Division(A=addition_4, B=2)

# ---- group: Original Radius of Curvature
cull_i_2 = CullIndex(List=explode.Vertices, Indices="-1", Wrap=True)
shift_4 = ShiftList(List=cull_i_2, Shift=2, Wrap=True)
shift_5 = ShiftList(List=cull_i_2, Shift=1, Wrap=True)
circle_2 = Circle3Pt(PointA=cull_i_2, PointB=shift_5, PointC=shift_4)  # -> Circle, Plane, simplify(Radius)
shift_6 = ShiftList(List=circle_2.Radius, Shift=-1, Wrap=True)
addition_5 = Addition(A=circle_2.Radius, B=shift_6)
division_5 = Division(A=addition_5, B=2)

# ----
expression_8 = Expression(E=panel, D=D_2, r=division_5, R=division_4, Expression="E*D/2/(R*(r+D/2))")
subtraction_2 = Subtraction(A=division_5, B=division_4)
crv_5 = Curve(explode.Segments)
multiplication_10 = Multiplication(A=subtraction_2, B=expression_8)
len_5 = Length(Curve=crv_5)
abs = Absolute(Value=multiplication_10)
len_6 = Length(Curve=crv_4)
subtraction_3 = Subtraction(A=len_6, B=len_5)
panel_8 = Panel(abs)
division_6 = Division(A=subtraction_3, B=len_5)
multiplication_11 = Multiplication(A=division_6, B=panel)
abs_2 = Absolute(Value=multiplication_11)
panel_9 = Panel(abs_2)
addition_6 = Addition(A=abs_2, B=abs)
number_slider_2 = Slider(0, range=0..100)
bnd = Bounds(Numbers=flatten(addition_6))
panel_10 = Panel(addition_6)
dedomain = DeconstructDomain(Domain=bnd)  # -> Start, End
gradient = Gradient(
    LowerLimit=dedomain.Start,
    UpperLimit=dedomain.End,
    Parameter=addition_6,
    stops=[0: RGB(75, 107, 169), 0.247: RGB(173, 203, 249), 0.5: RGB(254, 244, 84), 0.752: RGB(234, 126, 0), 1: RGB(234, 38, 0)])
panel_11 = Panel("5e6")
panel_12 = Panel(dedomain.End)
# Ice Bending Moment
preview = CustomPreview(Geometry=crv_4, Shader=gradient)

eval_13 = Evaluate(F="E*D/2/R", E=panel_3, D=D, R=division_4)
multiplication_12 = Multiplication(A=division_6, B=panel_3)
abs_3 = Absolute(Value=multiplication_12)
addition_7 = Addition(A=abs_3, B=eval_13)
panel_13 = Panel(abs_3)
bnd_2 = Bounds(Numbers=flatten(addition_7))
dedomain_2 = DeconstructDomain(Domain=bnd_2)  # -> Start, End
panel_14 = Panel(addition_7)
gradient_2 = Gradient(
    LowerLimit=dedomain_2.Start,
    UpperLimit=dedomain_2.End,
    Parameter=addition_7,
    stops=[0: RGB(75, 107, 169), 0.247: RGB(173, 203, 249), 0.5: RGB(254, 244, 84), 0.752: RGB(234, 126, 0), 1: RGB(234, 38, 0)])
# FRP Bending Moment
panel_15 = Panel(dedomain_2.End)
panel_16 = Panel("5e8")
preview_2 = CustomPreview(Geometry=crv_4, Shader=gradient_2)

cp_4 = ControlPoints(Curve=crv_2)  # -> Points, Weights, Knots
cp_5 = ControlPoints(Curve=crv_3)  # -> Points, Weights, Knots
dist = Distance(PointA=cp_4.Points, PointB=cp_5.Points)
avr_3 = Average(Input=dist)  # -> flatten(ArithmeticMean)
bnd_3 = Bounds(Numbers=avr_3)
dedomain_3 = DeconstructDomain(Domain=bnd_3)  # -> Start, End
gradient_3 = Gradient(
    LowerLimit=dedomain_3.Start,
    UpperLimit=dedomain_3.End,
    Parameter=avr_3,
    stops=[0: RGB(75, 0, 130), 0.112: RGB(39, 72, 161), 0.259: RGB(1, 192, 229), 0.394: RGB(18, 178, 90), 0.549: RGB(79, 186, 8), 0.696: RGB(220, 237, 32), 0.845: RGB(247, 159, 20), 1: RGB(242, 0, 0)])
panel_17 = Panel(dedomain_3.End)
# Deviation Analysis
preview_3 = CustomPreview(Geometry=crv_2, Shader=gradient_3)

len_7 = Length(Curve=crv_2)
len_8 = Length(Curve=crv_3)
division_7 = Division(A=len_7, B=len_8)
bnd_4 = Bounds(Numbers=division_7)
dedomain_4 = DeconstructDomain(Domain=bnd_4)  # -> Start, End
gradient_4 = Gradient(
    LowerLimit=dedomain_4.Start,
    UpperLimit=dedomain_4.End,
    Parameter=division_7,
    stops=[0: RGB(75, 0, 130), 0.129: RGB(39, 72, 161), 0.261: RGB(1, 192, 229), 0.401: RGB(18, 178, 90), 0.548: RGB(79, 186, 8), 0.679: RGB(220, 237, 32), 0.806: RGB(247, 159, 20), 0.933: RGB(242, 0, 0)])
# Axial Force Analysis
preview_4 = CustomPreview(Geometry=crv_2, Shader=gradient_4)
